# Grasshopper definition RossiniereRoof.ghx (Grasshopper 1.0.7)
# plug-ins: NGon, Kangaroo2 Components

brep = Brep(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)
diamonddivide = DiamondDivide(
    Surface=brep,
    U=Slider(16, range=0..100),
    V=Slider(20, range=0..100),
    Boundary=0,
    Swap=True,
    Flip=True,
    Divisions=True,
    Explode=False)

mesh = Mesh(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)
top = GetPolylines(Mesh=mesh)
fromp = FromPolylines(Curves=top, Min_Triangulation=False)
brep_2 = Brep(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)
planarize2 = Planarize2(
    Mesh=fromp,
    Tangential=1e-05,
    Iterations=Slider(10000, range=0..10000),
    StaticSolver=invert(False),
    Run=invert(False),
    Reset=False)
debrep = DeconstructBrep(Brep=brep_2)  # -> Faces, Edges, Vertices
planar = IsPlanar(Surface=debrep.Faces, Interior=True)  # -> Planar, Plane
pflip = FlipPlane(Plane=planar.Plane, ReverseX=False, ReverseY=False, SwapAxes=True)
extrude_edges = ExtrudeEdges(Mesh=planarize2, Dist=0.2, Cap=invert(False), Merge=False, BothSides=False)
top_2 = GetPolylines(Mesh=planarize2)
cutmesh = CutMesh(M=extrude_edges, P=pflip)
boundary = BoundarySurfaces(Edges=cutmesh)
fromp_2 = FromPolylines(Curves=top_2, Min_Triangulation=False)
join = BrepJoin(Breps=boundary)  # -> Breps, Closed
cutmesh_2 = CutMesh(M=fromp_2, P=pflip)  # disabled
cap = CapHoles(Brep=join.Breps)
fromp_3 = FromPolylines(Curves=cutmesh_2, Min_Triangulation=False)  # disabled
debrep_2 = DeconstructBrep(Brep=cap)  # -> Faces, Edges, Vertices
mesh_2 = Mesh(fromp_3)  # disabled
join_2 = BrepJoin(Breps=debrep_2.Faces)  # -> Breps, Closed
medges = MeshEdges(Mesh=mesh_2)  # -> NakedEdges, InteriorEdges, NonManifoldEdges; disabled
group = Group(Objects=flatten(join_2.Breps))
number_slider = Slider(1000, range=0..1000)  # disabled
join_3 = JoinCurves(Curves=medges.NakedEdges, Preserve=False)  # disabled
number_slider_2 = Slider(3.079, range=0..50)  # disabled
crv = Curve(join_3)  # disabled
divide = DivideCurve(Curve=crv, Count=number_slider, Kinks=False)  # -> flatten(Points), Tangents, Parameters; disabled
c_script = CSharpScript(
    P=mesh_2,
    heatPoints=divide.Points,
    isoFix=crv,
    textureScale=number_slider_2,
    Reference=["C:\USERS\PETRA\DOWNLOADS\meshedit2000\170625\Plankton.dll", "C:\USERS\PETRA\DOWNLOADS\meshedit2000\170625\Plankton.gha"])  # -> out, Mesh, Values, Gradient; inputs P: Mesh, heatPoints: list of Point3d, coldPoints: list of Point3d, isoFix: list of Polyline, textureScale: Double; disabled
# ---------- c_script: C# usings ----------
using Plankton;
using PlanktonGh;
using System.Linq;
using System.Threading.Tasks;
# ---------- c_script: C# ----------
    /*
    Script by Daniel Piker 03/07/2020
    updated 27/07/2020
    */
   // if(reset || pm == null)
    {
      P.Faces.ConvertQuadsToTriangles();
      pm = P.ToPlanktonMesh();
      int vc = pm.Vertices.Count;
      storedweights = new double[vc][];
      storedneighbours = new int[vc][];
      values = new double[vc];
      fix = new int[vc];
      equalize = new int[isoFix.Count][];
      for(int i = 0;i < vc;i++)
      {
        storedweights[i] = cotanWeights(pm, i);
        storedneighbours[i] = pm.Vertices.GetVertexNeighbours(i);
        for(int j = 0;j < heatPoints.Count;j++)
        {
          if(pm.Vertices[i].ToPoint3d().DistanceToSquared(heatPoints[j]) < 0.001)
          {
            values[i] = 1;
            fix[i] = 1;
          }
        }
        for(int j = 0;j < coldPoints.Count;j++)
        {
          if(pm.Vertices[i].ToPoint3d().DistanceToSquared(coldPoints[j]) < 0.001)
          {
            values[i] = 0;
            fix[i] = 2;
          }
        }
      }

      for(int i = 0;i < isoFix.Count;i++)
      {
        Polyline thisPoly = isoFix[i];
        int polyCount = thisPoly.Count;
        if(thisPoly[thisPoly.Count - 1].Equals(thisPoly[0])) polyCount--;//don't count first point twice for closed curves
        equalize[i] = new int[polyCount];
        for(int j = 0;j < polyCount;j++)
        {
          for(int k = 0;k < vc;k++)
          {
            if(pm.Vertices[k].ToPoint3d().DistanceToSquared(thisPoly[j]) < 0.001)
            {
              equalize[i][j] = k;
              break;
            }
          }
        }
      }

      gradient = new Vector3d[vc];
      meshOut = P.DuplicateMesh();

      edgeGradient = null;
    }


    //  if(step)
    {
      // if(!Poisson)
      {
        for(int k = 0;k < 500;k++)
        {
          double[] newValues = new double[values.Length];
          Parallel.For(0, pm.Vertices.Count,
            i => {

            if(fix[i] == 0)
            {
              int[] neighbours = storedneighbours[i];
              double[] weights = storedweights[i];
              double newValue = 0;
              for(int j = 0;j < neighbours.Length;j++)
              {
                newValue += weights[j] * values[neighbours[j]];
              }
              newValues[i] = newValue;
            }
            else newValues[i] = values[i];
            });

          for(int i = 0;i < equalize.Length;i++)
          {
            double avg = 0;
            for(int j = 0;j < equalize[i].Length;j++)avg += newValues[equalize[i][j]];
            avg /= equalize[i].Length;
            for(int j = 0;j < equalize[i].Length;j++) newValues[equalize[i][j]] = avg;
          }
          values = newValues;
        }

        double min = values.Min();
        double max = values.Max();
        double mult = 1.0 / (max - min);
        for(int i = 0;i < values.Length;i++) values[i] = mult * (values[i] - min);

        //gradient = gradients(pm, values);
        edgeGradient = null;
      }

      // else
      {
        if(edgeGradient == null)
        {
          gradient = gradients(pm, values);
          double avgGradientLength = 0;
          for(int i = 0;i < gradient.Length;i++)
          {
            avgGradientLength += gradient[i].Length;
          }
          avgGradientLength /= gradient.Length;

          edgeGradient = new Vector3d[pm.Halfedges.Count / 2];
          for(int i = 0;i < pm.Halfedges.Count / 2;i++)
          {
            int start = pm.Halfedges[2 * i].StartVertex;
            int end = pm.Halfedges[(2 * i) + 1].StartVertex;
            Vector3d sv = gradient[start];
            Vector3d ev = gradient[end];
            Vector3d thisEdgeGradient = sv + ev;
            thisEdgeGradient.Unitize();
            thisEdgeGradient *= avgGradientLength;
            edgeGradient[i] = thisEdgeGradient;
          }
        }


        for(int k = 0;k < 2000;k++)
        {
          double[] heChange = new double[pm.Halfedges.Count];
          Parallel.For(0, pm.Halfedges.Count / 2,
            i => {
            int start = pm.Halfedges[2 * i].StartVertex;
            int end = pm.Halfedges[(2 * i) + 1].StartVertex;
            Vector3d edgeVector = pm.Vertices[end].ToPoint3d() - pm.Vertices[start].ToPoint3d();
            double projected = edgeVector * edgeGradient[i];
            double currentDifference = values[end] - values[start];
            double change = currentDifference - projected;
            heChange[2 * i] = 1 * change;
            heChange[(2 * i) + 1] = -1 * change;
            });

          Parallel.For(0, pm.Vertices.Count,
            i => {
            {
              //   if(fix[i] == 0)
              {
                double[] weights = storedweights[i];
                int[] halfedges = pm.Vertices.GetHalfedges(i);
                for(int j = 0;j < halfedges.Length;j++)
                {
                  values[i] += heChange[halfedges[j]] * weights[j];
                }
              }
            }
            });

          for(int i = 0;i < equalize.Length;i++)
          {
            double avg = 0;
            for(int j = 0;j < equalize[i].Length;j++)avg += values[equalize[i][j]];
            avg /= equalize[i].Length;
            for(int j = 0;j < equalize[i].Length;j++) values[equalize[i][j]] = avg;
          }
        }
      }
    }

    for(int i = 0;i < meshOut.Vertices.Count;i++)
    {
      meshOut.TextureCoordinates.SetTextureCoordinate(i, new Point2f(0, (float) (values[i] * textureScale)));
    }

    Mesh = meshOut;
    //the scalar and gradient vectors per vertex should you want them, though outputing these lists slows things down, so not included by default
    //  if(Output)
    {
      Values = values;
      Gradient = gradient;
    }
# ---------- c_script: C# additional code ----------
  PlanktonMesh pm;
  double[] values;
  double[][] storedweights;
  int[][] storedneighbours;
  Vector3d[] gradient;
  Vector3d[] edgeGradient;
  int[] fix;
  int[][] equalize;
  Mesh meshOut;

  static Vector3d[] gradients(PlanktonMesh P, double[] values)
  {
    Vector3d[] halfedgeGradients = new Vector3d[P.Halfedges.Count];
    for(int i = 0;i < P.Halfedges.Count / 2;i++)
    {
      int start = P.Halfedges[2 * i].StartVertex;
      int end = P.Halfedges[2 * i + 1].StartVertex;
      Vector3d v = P.Vertices[end].ToPoint3d() - P.Vertices[start].ToPoint3d();
      double lengthSquared = v.SquareLength;
      double diff = values[end] - values[start];
      Vector3d edgeGradient = v * (diff / lengthSquared);
      halfedgeGradients[2 * i] = halfedgeGradients[2 * i + 1] = edgeGradient;
    }
    Vector3d[] vertexGradients = new Vector3d[P.Vertices.Count];
    for(int i = 0;i < P.Vertices.Count;i++)
    {
      double[] weights = cotanWeights(P, i);
      Vector3d gradient = new Vector3d();
      int[] halfedges = P.Vertices.GetHalfedges(i);
      for(int j = 0;j < halfedges.Length;j++)
      {
        gradient += halfedgeGradients[halfedges[j]] * weights[j];
      }
      vertexGradients[i] = gradient;
    }
    return vertexGradients;
  }

  static double[] cotanWeights(PlanktonMesh P, int i)
  {
    int[] Neighbours = P.Vertices.GetVertexNeighbours(i);
    Point3d Vertex = P.Vertices[i].ToPoint3d();
    int valence = P.Vertices.GetValence(i);
    Point3d[] NeighbourPts = new Point3d[valence];
    Vector3d[] Radial = new Vector3d[valence];
    Vector3d[] Around = new Vector3d[valence];
    double[] CotWeight = new double[valence];
    double WeightSum = 0;
    for (int j = 0; j < valence; j++)
    {
      NeighbourPts[j] = P.Vertices[Neighbours[j]].ToPoint3d();
      Radial[j] = NeighbourPts[j] - Vertex;
    }
    for (int j = 0; j < valence; j++)
    {
      Around[j] = NeighbourPts[(j + 1) % valence] - NeighbourPts[j];
    }
    int[] halfEdges = P.Vertices.GetHalfedges(i);
    for (int j = 0; j < Neighbours.Length; j++)
    {
      int previous = (j + valence - 1) % valence;
      int next = (j + 1) % valence;

      Vector3d Cross1 = Vector3d.CrossProduct(Radial[previous], Around[previous]);
      double Dot1 = Radial[previous] * Around[previous];
      double cwa = Math.Abs(Dot1 / Cross1.Length);

      Vector3d Cross2 = Vector3d.CrossProduct(Radial[next], Around[j]);
      double Dot2 = Radial[next] * Around[j];
      double cwb = Math.Abs(Dot2 / Cross2.Length);

      if(P.Halfedges[halfEdges[j]].AdjacentFace == -1){cwa = 0;}
      if(P.Halfedges[P.Halfedges.GetPairHalfedge(halfEdges[j])].AdjacentFace == -1){cwb = 0;}
      CotWeight[j] = cwa + cwb;
      WeightSum += CotWeight[j];
    }
    for (int j = 0; j < CotWeight.Length; j++) CotWeight[j] /= WeightSum;
    return CotWeight;
  }
# ---------- end c_script ----------
number_slider_3 = Slider(53, range=0..100)  # disabled
c_script_2 = CSharpScript(M=c_script.Mesh, contourCount=number_slider_3)  # -> out, Contours; inputs M: Mesh, contourCount: Int32; disabled
# ---------- c_script_2: C# usings ----------
using System.Linq;
using System.Threading.Tasks;
# ---------- c_script_2: C# ----------
    List<Line> all = new List<Line>();
    List<Line>[] contours = new List<Line>[contourCount];
    double[] values = new double[M.Vertices.Count];
    for(int i = 0;i < M.Vertices.Count;i++) values[i] = M.TextureCoordinates[i].Y;
    double lower = values.Min();
    double upper = values.Max();
    double stepsize = (upper - lower) / (contourCount + 1.0);

    Parallel.For(0, contourCount,
      j => {
      double iso = lower + ((j + 1) * stepsize);
      List<Line> lines = new List<Line>();
      for(int i = 0;i < M.Faces.Count;i++)
      {
        int va = M.Faces[i].A;
        int vb = M.Faces[i].B;
        int vc = M.Faces[i].C;
        double a = M.TextureCoordinates[va].Y - iso;
        double b = M.TextureCoordinates[vb].Y - iso;
        double c = M.TextureCoordinates[vc].Y - iso;
        Point3d pa = M.Vertices.Point3dAt(va);
        Point3d pb = M.Vertices.Point3dAt(vb);
        Point3d pc = M.Vertices.Point3dAt(vc);

        List<Point3d> ends = new List<Point3d>();
        if(a < 0 != b < 0)
        {
          double wa = b / (b - a);
          double wb = 1 - wa;
          ends.Add(wa * pa + wb * pb);
        }
        if(a < 0 != c < 0)
        {
          double wa = c / (c - a);
          double wc = 1 - wa;
          ends.Add(wa * pa + wc * pc);
        }
        if(c < 0 != b < 0)
        {
          double wb = c / (c - b);
          double wc = 1 - wb;
          ends.Add(wb * pb + wc * pc);
        }
        if(ends.Count == 2) lines.Add(new Line(ends[0], ends[1]));
      }
      contours[j] = lines;
      });

    DataTree<Line> contoursTree = new DataTree<Line>();
    for(int i = 0; i < contourCount;i++)
    {
      GH_Path path = new GH_Path(i);
      for (int j = 0; j < contours[i].Count;j++)
      {
        contoursTree.Add(contours[i][j], path);
      }
    }

    Contours = contoursTree;
# ---------- end c_script_2 ----------
mesh_3 = Mesh(c_script.Mesh)  # disabled
dupln = RemoveDuplicateLines(Lines=c_script_2.Contours, Tolerance=0.01)  # disabled
end = EndPoints(Curve=dupln)  # -> Start, End; disabled
pt = Point([end.Start, end.End])  # disabled
number_slider_4 = Slider(0.138, range=0..1)  # disabled
curveends = CurveEnds(Curves=dupln, Points=pt, Tolerance=0.1)  # disabled
join_4 = JoinCurves(Curves=flatten(curveends), Preserve=False)  # disabled
divlength = DivideLength(Curve=join_4, Length=number_slider_4)  # -> Points, Tangents, Parameters; disabled
pline = PolyLine(Vertices=divlength.Points, Closed=invert(False))  # disabled
smoothpline = SmoothPolyline(Polyline=pline, Strength=0.1, Times=100)  # disabled
cp = ControlPoints(Curve=smoothpline)  # -> Points, Weights, Knots; disabled
Z = UnitZ(Factor=1)  # disabled
move = Move(Geometry=cp.Points, Motion=Z)  # -> Geometry, Transform; disabled
project = ProjectPoint(Point=move.Geometry, Direction=Vector(0, 0, -1), Geometry=mesh_3)  # -> Point, Index; disabled
number_slider_5 = Slider(0.1, range=0..0.1)  # disabled
pline_2 = PolyLine(Vertices=project.Point, Closed=False)  # disabled
divlength_2 = DivideLength(Curve=pline_2, Length=number_slider_5)  # -> Points, simplify(Tangents), Parameters; disabled
meshcp = MeshClosestPoint(Point=divlength_2.Points, Mesh=mesh_3)  # -> Point, Index, Parameter; disabled
meval = MeshEval(Mesh=mesh_3, Parameter=meshcp.Parameter)  # -> simplify(Point), Normal, Colour; disabled
xprod = CrossProduct(VectorA=meval.Normal, VectorB=divlength_2.Tangents, Unitize=False)  # -> Vector, Length; disabled
pl = ConstructPlane(Origin=divlength_2.Points, XAxis=divlength_2.Tangents, YAxis=xprod.Vector)  # disabled
number_slider_6 = Slider(6.46, range=0..180)  # disabled
number_slider_7 = Slider(0.5, range=0..1)  # disabled
number_slider_8 = Slider(0, range=0..1)  # disabled
number_slider_9 = Slider(0, range=0..1)  # disabled
number_slider_10 = Slider(0.15, range=0..1)  # disabled
number_slider_11 = Slider(6.37, range=0..180)  # disabled
rot3d = Rotate3D(Geometry=pl, Angle=degrees(number_slider_6), Center=pl, Axis=xprod.Vector)  # -> Geometry, Transform; disabled
dom = ConstructDomain(DomainStart=number_slider_8, DomainEnd=expr("-X", number_slider_7))  # disabled
rot3d_2 = Rotate3D(Geometry=rot3d.Geometry, Angle=expr("-X", degrees(number_slider_11)), Center=pl, Axis=divlength_2.Tangents)  # -> Geometry, Transform; disabled
dom_2 = ConstructDomain(DomainStart=number_slider_9, DomainEnd=expr("-X", number_slider_10))  # disabled
rectangle = Rectangle(Plane=rot3d_2.Geometry, XSize=dom_2, YSize=dom, Radius=0)  # -> Rectangle, Length; disabled
smesh = SimpleMesh(Brep=rectangle.Rectangle)  # disabled
